# Grasshopper definition forward_rgb_encoding.gh (Grasshopper 1.0.7)

# ---- group: 接入体块和切面点
lv1_brep = Brep(<brep referenced from the Rhino model>)

# ---- group: 接入体块和切面点 / LV2_Brep
brep = Brep(<brep referenced from the Rhino model>)

# ---- group: 接入体块和切面点 / LV3_Brep
brep_2 = Brep(<brep referenced from the Rhino model>)

# ---- group: 接入体块和切面点 / LV1_Point
point = Point(<point referenced from the Rhino model>)

# ---- group: 接入体块和切面点 / LV2_Point
point_2 = Point(<point referenced from the Rhino model>)

# ---- group: 接入体块和切面点 / LV3_Point
point_3 = Point(<point referenced from the Rhino model>)

# ---- group: 将每组分别放置到工作平面
deconstruct = Deconstruct(Point=point)  # -> XComponent, YComponent, ZComponent
deconstruct_2 = Deconstruct(Point=point_2)  # -> XComponent, YComponent, ZComponent
subtraction = Subtraction(A=0, B=deconstruct.ZComponent)
subtraction_2 = Subtraction(A=0, B=deconstruct_2.ZComponent)
unit_z = UnitZ(Factor=subtraction)
move = Move(Geometry=brep, Motion=unit_z)  # -> Geometry, Transform
move_2 = Move(Geometry=point_2, Motion=unit_z)  # -> Geometry, Transform
unit_z_2 = UnitZ(Factor=subtraction_2)
move_3 = Move(Geometry=brep_2, Motion=unit_z_2)  # -> Geometry, Transform
move_4 = Move(Geometry=point_3, Motion=unit_z_2)  # -> Geometry, Transform

# ---- group: 点投影到顶面
deconstruct_3 = Deconstruct(Point=point)  # -> XComponent, YComponent, ZComponent
addition = Addition(A=deconstruct_3.ZComponent, B=0.01)
construct_point = ConstructPoint(XCoordinate=0, YCoordinate=0, ZCoordinate=addition)
square = Square(Plane=construct_point, Size="1", ExtentX="512", ExtentY="512")  # -> Cells, Points
area = Area(Geometry=square.Cells)  # -> Area, simplify(Centroid)
mesh_brep = MeshBrep(
    Brep=lv1_brep,
    Settings={GridMaxCount=0, GridMinCount=16, JaggedSeams=False, MaxEdgeLength=0, MinEdgeLength=0.0001, MinTolerance=0, Refine=True, RefineAngle=0, RelativeTolerance=0.65, SimplePlanes=True, Tolerance=0})
mesh_ray = MeshRay(Mesh=mesh_brep, Point=square.Points, Direction=" 0,0,-1")  # -> Point, Hit

deconstruct_4 = Deconstruct(Point=move_2.Geometry)  # -> XComponent, YComponent, ZComponent
addition_2 = Addition(A=deconstruct_4.ZComponent, B=0.01)
construct_point_2 = ConstructPoint(XCoordinate=0, YCoordinate=0, ZCoordinate=addition_2)
square_2 = Square(Plane=construct_point_2, Size="1", ExtentX="512", ExtentY="512")  # -> Cells, Points
area_2 = Area(Geometry=square_2.Cells)  # -> Area, simplify(Centroid)
mesh_brep_2 = MeshBrep(
    Brep=move.Geometry,
    Settings={GridMaxCount=0, GridMinCount=16, JaggedSeams=False, MaxEdgeLength=0, MinEdgeLength=0.0001, MinTolerance=0, Refine=True, RefineAngle=0, RelativeTolerance=0.65, SimplePlanes=True, Tolerance=0})
mesh_ray_2 = MeshRay(Mesh=mesh_brep_2, Point=square_2.Points, Direction=" 0,0,-1")  # -> Point, Hit

deconstruct_5 = Deconstruct(Point=move_4.Geometry)  # -> XComponent, YComponent, ZComponent
addition_3 = Addition(A=deconstruct_5.ZComponent, B=0.1)
construct_point_3 = ConstructPoint(XCoordinate=0, YCoordinate=0, ZCoordinate=addition_3)
square_3 = Square(Plane=construct_point_3, Size="1", ExtentX="512", ExtentY="512")  # -> Cells, Points
area_3 = Area(Geometry=square_3.Cells)  # -> Area, simplify(Centroid)
mesh_brep_3 = MeshBrep(
    Brep=move_3.Geometry,
    Settings={GridMaxCount=0, GridMinCount=16, JaggedSeams=False, MaxEdgeLength=0, MinEdgeLength=0.0001, MinTolerance=0, Refine=True, RefineAngle=0, RelativeTolerance=0.65, SimplePlanes=True, Tolerance=0})
mesh_ray_3 = MeshRay(Mesh=mesh_brep_3, Point=square_3.Points, Direction=" 0,0,-1")  # -> Point, Hit

# ---- group: 计算距离并投映到RGB数值
deconstruct_6 = Deconstruct(Point=mesh_ray.Point)  # -> XComponent, YComponent, ZComponent
subtraction_3 = Subtraction(A=deconstruct_3.ZComponent, B=deconstruct_6.ZComponent)
absolute = Absolute(Value=subtraction_3)
bounds = Bounds(Numbers=flatten(absolute))
remap_numbers = RemapNumbers(Value=absolute, Source=bounds, Target=" 0 to 255")  # -> Mapped, simplify(Clipped)
subtraction_4 = Subtraction(A=remap_numbers.Clipped, B=255)
absolute_2 = Absolute(Value=subtraction_4)

deconstruct_7 = Deconstruct(Point=mesh_ray_2.Point)  # -> XComponent, YComponent, ZComponent
subtraction_5 = Subtraction(A=deconstruct_4.ZComponent, B=deconstruct_7.ZComponent)
absolute_3 = Absolute(Value=subtraction_5)
bounds_2 = Bounds(Numbers=flatten(absolute_3))
remap_numbers_2 = RemapNumbers(Value=absolute_3, Source=bounds_2, Target=" 0 to 255")  # -> Mapped, simplify(Clipped)
subtraction_6 = Subtraction(A=remap_numbers_2.Mapped, B=255)
absolute_4 = Absolute(Value=subtraction_6)

deconstruct_8 = Deconstruct(Point=mesh_ray_3.Point)  # -> XComponent, YComponent, ZComponent
subtraction_7 = Subtraction(A=deconstruct_5.ZComponent, B=deconstruct_8.ZComponent)
absolute_5 = Absolute(Value=subtraction_7)
bounds_3 = Bounds(Numbers=flatten(absolute_5))
remap_numbers_3 = RemapNumbers(Value=absolute_5, Source=bounds_3, Target=" 0 to 255")  # -> Mapped, simplify(Clipped)
subtraction_8 = Subtraction(A=remap_numbers_3.Clipped, B=255)
absolute_6 = Absolute(Value=subtraction_8)

# ---- group: 生成网格并着色
mesh_plane = MeshPlane(Boundary={Plane=PlaneXY(256, 256, 0), Size=Domain2(u=-256..256, v=-256..256)}, WidthCount="512", HeightCount="512")  # -> Mesh, Area
colour_rgb = ColourRGB(Alpha=255, Red=absolute_2, Green=absolute_4, Blue=absolute_6)
flip_matrix = FlipMatrix(Data=colour_rgb)  # -> flatten(Data)
deconstruct_mesh = DeconstructMesh(Mesh=mesh_plane.Mesh)  # -> Vertices, Faces, Colours, Normals
construct_mesh = ConstructMesh(Vertices=deconstruct_mesh.Vertices, Faces=deconstruct_mesh.Faces, Colours=flip_matrix)

# ----
mesh = Mesh(construct_mesh)
