# Grasshopper definition inverse_rgb_decoding.gh (Grasshopper 1.0.7)

resolution = Panel("200")
subtraction = Subtraction(A=resolution, B=1)
range = Range(Domain=Domain(0, 1), Steps=subtraction)
remap_numbers = RemapNumbers(Value=range, Source=Domain(0, 1), Target="0 to 512")  # -> Mapped, Clipped
construct_point = ConstructPoint(XCoordinate=graft(remap_numbers.Mapped), YCoordinate=remap_numbers.Mapped, ZCoordinate=0)
division = Division(A="512", B=subtraction)
image_sampler = ImageSampler(construct_point, Filter="Green", Interpolate=False, Umax=512, Umin=0, Vmax=512, Vmin=0, Wrap=1)
image_sampler_2 = ImageSampler(construct_point, Filter="Blue", Interpolate=False, Umax=512, Umin=0, Vmax=512, Vmin=0, Wrap=1)
image_sampler_3 = ImageSampler(construct_point, Filter="Red", Interpolate=False, Umax=512, Umin=0, Vmax=512, Vmin=0, Wrap=1)
construct_domain = ConstructDomain(DomainStart=0, DomainEnd=division)
floor_h = Panel("0")
_2f_h = Panel("15")
_3fh = Panel("30")
floor_h_2 = Panel("45")
subtraction_2 = Subtraction(A=_2f_h, B=floor_h)
subtraction_3 = Subtraction(A=_3fh, B=_2f_h)
subtraction_4 = Subtraction(A=floor_h_2, B=_3fh)
rectangle = Rectangle(Plane=construct_point, XSize=construct_domain, YSize=construct_domain, Radius=0)  # -> Rectangle, Length
construct_domain_2 = ConstructDomain(DomainStart="0", DomainEnd=subtraction_2)
construct_domain_3 = ConstructDomain(DomainStart="0", DomainEnd=subtraction_4)
construct_domain_4 = ConstructDomain(DomainStart="0", DomainEnd=subtraction_3)
remap_numbers_2 = RemapNumbers(Value=image_sampler_3, Source=" 0 to 1", Target=construct_domain_2)  # -> Mapped, Clipped
remap_numbers_3 = RemapNumbers(Value=image_sampler, Source=" 0 to 1", Target=construct_domain_4)  # -> Mapped, Clipped
remap_numbers_4 = RemapNumbers(Value=image_sampler_2, Source=" 0 to 1", Target=construct_domain_3)  # -> Mapped, Clipped
construct_domain_5 = ConstructDomain(DomainStart="0", DomainEnd=remap_numbers_2.Mapped)
construct_domain_6 = ConstructDomain(DomainStart="0", DomainEnd=remap_numbers_3.Mapped)
construct_domain_7 = ConstructDomain(DomainStart="0", DomainEnd=remap_numbers_4.Mapped)
unit_z = UnitZ(Factor=_3fh)
unit_z_2 = UnitZ(Factor=floor_h)
unit_z_3 = UnitZ(Factor=_2f_h)
move = Move(Geometry=rectangle.Rectangle, Motion=unit_z)  # -> Geometry, Transform
move_2 = Move(Geometry=rectangle.Rectangle, Motion=unit_z_2)  # -> Geometry, Transform
move_3 = Move(Geometry=rectangle.Rectangle, Motion=unit_z_3)  # -> Geometry, Transform
r_block_off = Slider(35.7, range=0..100)
g_block_off = Slider(34.1, range=0..100)
b_block_off = Slider(45.3, range=0..100)
box_rectangle = BoxRectangle(Rectangle=move.Geometry, Height=construct_domain_7)
box_rectangle_2 = BoxRectangle(Rectangle=move_2.Geometry, Height=construct_domain_5)
box_rectangle_3 = BoxRectangle(Rectangle=move_3.Geometry, Height=construct_domain_6)
volume = Volume(Geometry=box_rectangle)  # -> Volume, Centroid
volume_2 = Volume(Geometry=box_rectangle_2)  # -> Volume, Centroid
volume_3 = Volume(Geometry=box_rectangle_3)  # -> Volume, Centroid
larger_than = LargerThan(FirstNumber=volume.Volume, SecondNumber=b_block_off)  # -> LargerThan, OrEqualTo
larger_than_2 = LargerThan(FirstNumber=volume_2.Volume, SecondNumber=r_block_off)  # -> LargerThan, OrEqualTo
larger_than_3 = LargerThan(FirstNumber=volume_3.Volume, SecondNumber=g_block_off)  # -> LargerThan, OrEqualTo
dispatch = Dispatch(List=box_rectangle, DispatchPattern=larger_than.LargerThan)  # -> ListA, ListB
dispatch_2 = Dispatch(List=box_rectangle_2, DispatchPattern=larger_than_2.LargerThan)  # -> ListA, ListB
dispatch_3 = Dispatch(List=box_rectangle_3, DispatchPattern=larger_than_3.LargerThan)  # -> ListA, ListB
box = Box(dispatch_2.ListA)
box_2 = Box(dispatch.ListA)
box_3 = Box(dispatch_3.ListA)
create_material = CreateMaterial(
    Diffuse=ColourSwatch(SwatchColor=RGB(214, 214, 214)),
    Specular=RGB(255, 255, 255),
    Emission=RGB(0, 0, 0),
    Transparency=0,
    Shine=0)
custom_preview = CustomPreview(Geometry=box_2, Material=create_material)
custom_preview_2 = CustomPreview(Geometry=box_3, Material=create_material)
custom_preview_3 = CustomPreview(Geometry=box, Material=create_material)
